# Grasshopper definition TIleGeneration.gh (Grasshopper 1.0.8)
# plug-ins: RhinoCodePluginGH, Human, ShapeDiverForGrasshopper

# ---- group: Tpl
plugins_used = Panel("RhinoCodePluginGH ")
timer = Timer(Interval=900000, TimerInterval=900000, Target=o_getcomps2)  # disabled
o_getcomps2 = OTools_GetComponents2(x=Button())  # inputs x: Boolean; plug-in component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

# ---- group: Colors
_1 = ColourSwatch(SwatchColor=RGB(209, 149, 71))
_3 = ColourSwatch(SwatchColor=RGB(112, 255, 198))
_4 = ColourSwatch(SwatchColor=RGB(253, 255, 201))
_5 = ColourSwatch(SwatchColor=RGB(35, 84, 219))
_6 = ColourSwatch(SwatchColor=RGB(214, 175, 154))
_7 = ColourSwatch(SwatchColor=RGB(227, 123, 163))
_8 = ColourSwatch(SwatchColor=RGB(255, 0, 98))
_9 = ColourSwatch(SwatchColor=RGB(255, 0, 98))
_0 = ColourSwatch(SwatchColor=RGB(64, 64, 64))
_2 = ColourSwatch(SwatchColor=RGB(242, 170, 170))
panel = Panel("""INPUT
Process
Analysis
Output
Bake
Display
Archicad
Speckle
Annotation
VIZ""")
merge = Merge(Data1=_0, Data2=_1, Data3=_2, Data4=_3, Data5=_4, Data6=_5, Data7=_6, Data8=_7, Data9=_8, Data10=_9)
gh_canvas_style = GHCanvasStyle(
    panel_default_color=ColourSwatch(SwatchColor=RGB(255, 255, 255)),
    canvas_background_color=ColourSwatch(SwatchColor=RGB(222, 220, 220)),
    canvas_gridline_color=ColourSwatch(SwatchColor=RGB(224, 175, 175)))  # -> out
# ---------- gh_canvas_style: Python ----------
import Grasshopper
import rhinoscriptsyntax as rs

if panel_default_color == None:
    panel_default_color = rs.CreateColor(255,250,90)
if canvas_background_color == None:
    canvas_background_color = rs.CreateColor(212,208,200)
if canvas_gridline_color == None:
    canvas_gridline_color = rs.CreateColor(0,0,0,30)

Grasshopper.GUI.Canvas.GH_Skin.panel_back = panel_default_color
Grasshopper.GUI.Canvas.GH_Skin.canvas_back = canvas_background_color
Grasshopper.GUI.Canvas.GH_Skin.canvas_grid = canvas_gridline_color

print "Cool Choices! I like your style"


ghenv.Component.Name = "GH Canvas Style"
ghenv.Component.NickName = 'GH Canvas Style'
ghenv.Component.Message = 'Love your style!'
# ---------- end gh_canvas_style ----------
default_color = ColourSwatch(SwatchColor=RGB(214, 206, 206))
timer_2 = Timer(Interval=2000, TimerInterval=2000, Target=group_colours)
panel_2 = Panel(gh_canvas_style)
group_colours = GroupColours(group_names=panel, colors=merge, default_color=default_color)  # -> out; inputs group_names: list, colors: list
# ---------- group_colours: Python ----------
import Grasshopper

doc = ghenv.Component.Attributes.Owner.OnPingDocument()
for i in doc.Objects:
    if str(type(i)) == "<type 'GH_Group'>":
        name_of_current_group = i.NickName.ToString()
        if name_of_current_group in group_names:
            index = group_names.index(name_of_current_group)
            color = colors[index]
            i.Colour = color
        else:
            i.Colour = default_color
print "No Problemo"

ghenv.Component.Name = "Group Colours"
ghenv.Component.NickName = 'Group Colours'
ghenv.Component.Message = 'Make sure your *inputs match*'
# ---------- end group_colours ----------
panel_3 = Panel(group_colours)

# ----
sddp = ShapeDiverDocumentPayload({AbsoluteTolerance=0, AngleTolerance=0, DistanceDisplayPrecision=0, GltfVersion="Gltf2", GrasshopperVersion="1.0.0008", InputGroups="{}", OutputGroups="{}", RelativeTolerance=0, RhinoVersion="8.15.25013.13002", UnitSystem=0, VersionCreated="1.22.0.0", VersionSaved="1.22.0.0"})
boundary_curve_xy = Curve(<curve referenced from the Rhino model>)
boundary_curve_custom = Curve(<curve referenced from the Rhino model>)
boundary_curve_xy_2 = Curve(<curve referenced from the Rhino model>)

boundary = BoundarySurfaces(Edges=boundary_curve_custom)
srf = Surface(boundary)
plane_finder = SurfacePlaneFinder(x=srf)  # -> out, plane_normal, reverse_normal, output_plane; inputs x: list of Surface
# ---------- plane_finder: Python ----------
import Rhino.Geometry as rg

# Manually set the component's name, nickname, and version
component_name = "Surface Plane Finder"
component_nickname = "plane_finder"
component_version = "v1.0"

# Check if the input `x` is a list
if isinstance(x, list):
    if len(x) > 0:
        input_item = x[0]  # Get the first item in the list
    else:
        input_item = None  # The list is empty
else:
    input_item = x  # Input is not a list

# Initialize `surface` as None
surface = None

# Check the type of the input and process accordingly
if input_item is not None:
    if isinstance(input_item, rg.Surface):
        # Input is a Surface
        surface = input_item
    elif isinstance(input_item, rg.Brep):
        # Input is a Brep, try to extract the first face
        if input_item.Faces.Count == 1:
            surface = input_item.Faces[0].UnderlyingSurface()  # Convert to Surface
        else:
            ghenv.Component.Message = f"{component_name} {component_version}\nInput is a polysurface."
    else:
        ghenv.Component.Message = f"{component_name} {component_version}\nInvalid input type."

# Proceed if a valid surface is extracted
if surface is not None:
    if surface.IsPlanar():
        # Get midpoints of the domain
        u = surface.Domain(0).Mid
        v = surface.Domain(1).Mid

        # Compute the normal
        normal = surface.NormalAt(u, v)
        normal.Unitize()

        # Reverse the normal
        reverse_normal = -normal

        # Compute the centroid
        if isinstance(surface, rg.PlaneSurface):
            # For PlaneSurface, use the bounding box to calculate the centroid
            bbox = surface.GetBoundingBox(True)
            centroid = bbox.Center
        else:
            # For other surfaces, use AreaCentroid
            success, centroid = surface.AreaCentroid()
            if not success:
                centroid = surface.PointAt(u, v)

        # Create a plane at the centroid with the normal
        plane = rg.Plane(centroid, normal)

        # Output
        plane_normal = normal
        reverse_normal = reverse_normal
        output_plane = plane
        ghenv.Component.Message = f"{component_name} {component_version}\nSurface is planar."
    else:
        plane_normal = None
        reverse_normal = None
        output_plane = None
        ghenv.Component.Message = f"{component_name} {component_version}\nSurface is NOT planar."
else:
    plane_normal = None
    reverse_normal = None
    output_plane = None
    ghenv.Component.Message = f"{component_name} {component_version}\nNo valid surface provided."

# Optional: Print debugging information
print(f"Component Name: {component_name}")
print(f"Component Nickname: {component_nickname}")
print(f"Component Version: {component_version}")
print(f"Input type: {type(input_item)}")

ghenv.Component.Name = component_name
ghenv.Component.NickName = component_nickname
# ---------- end plane_finder ----------
line = LineSDL(Start=plane_finder.output_plane, Direction=plane_finder.plane_normal, Length=Slider(11, range=0..100))

boundary_2 = BoundarySurfaces(Edges=boundary_curve_xy)
srf_2 = Surface(boundary_2)
plane_finder_2 = SurfacePlaneFinder(x=srf_2)  # -> out, plane_normal, reverse_normal, output_plane; inputs x: list of Surface; same code as plane_finder
line_2 = LineSDL(Start=plane_finder_2.output_plane, Direction=plane_finder_2.plane_normal, Length=Slider(11, range=0..100))

srf_3 = Surface(<surface referenced from the Rhino model>)  # disabled
plane_finder_3 = SurfacePlaneFinder(x=srf_3)  # -> out, plane_normal, reverse_normal, output_plane; inputs x: list of Surface; disabled; same code as plane_finder

# ---- group: VIZ
previewlw = CustomPreviewLineweights(Geometry=line, Shader=ColourSwatch(SwatchColor=RGB(255, 77, 0)), Thickness=Slider(0.2, range=0..1), Absolute=True)

previewlw_2 = CustomPreviewLineweights(Geometry=line_2, Shader=ColourSwatch(SwatchColor=RGB(255, 77, 0)), Thickness=Slider(0.2, range=0..1), Absolute=True)

# ---- group: INPUT
pt = Point(<point referenced from the Rhino model>)

pt_2 = Point(<point referenced from the Rhino model>)

# ----
vertproj = VerticalProjection(pt=pt, plane=plane_finder.output_plane)  # -> out, isContained, ProjectedPoint, Message; inputs pt: Point3d, plane: Plane
# ---------- vertproj: Python ----------
import Rhino.Geometry as rg

def project_point_vertically(pt, plane):
    """
    Projects a point vertically (along world Z-axis) onto a given plane.
    
    Args:
        pt (rg.Point3d): The input point.
        plane (rg.Plane): The target plane.

    Returns:
        tuple: (bool, projected_point, message)
    """
    # Compute the signed distance from the point to the plane
    dist = plane.DistanceTo(pt)

    # Create a vertical line from the point (World Z-axis)
    vertical_dir = rg.Vector3d(0, 0, 1)  # Global Z-axis
    vertical_line = rg.Line(pt - vertical_dir * 10000, pt + vertical_dir * 10000)  # Long enough line

    # Find intersection of the vertical line with the plane
    success, parameter = rg.Intersect.Intersection.LinePlane(vertical_line, plane)

    if success:
        projected_pt = vertical_line.PointAt(parameter)  # Get the actual intersection point

        # Determine if the point is on, above, or below the plane
        if abs(dist) < 1e-6:
            message = "Point is on the plane\nNo projection needed"
        elif dist > 0:
            message = "Point was above the plane\nProjected downward"
        else:
            message = "Point was below the plane\nProjected upward"

        return abs(dist) < 1e-6, projected_pt, message

    return False, pt, "No valid projection\nCheck input values"  # Fallback case

# Grasshopper Inputs:
# pt: Input point (Type Hint: Point3d)
# plane: Input plane (Type Hint: Plane)

is_on_plane, projected_pt, msg = project_point_vertically(pt, plane)

# Grasshopper Outputs:
isContained = is_on_plane  # Boolean if the point is on the plane
ProjectedPoint = projected_pt  # The actual projected Point3d
Message = msg  # Multi-line message output

# Set Grasshopper component metadata
if 'ghenv' in globals():
    ghenv.Component.Name = "Vertical Projection"
    ghenv.Component.NickName = "VertProj"
    ghenv.Component.Message = msg
# ---------- end vertproj ----------
panel_4 = Panel(vertproj.Message)
pl_origin = PlaneOrigin(Base=plane_finder.output_plane, Origin=vertproj.ProjectedPoint)
prot = RotatePlane(Plane=pl_origin, Angle=degrees(Slider(246, range=0..360)))

vertproj_2 = VerticalProjection(pt=pt_2, plane=plane_finder_2.output_plane)  # -> out, isContained, ProjectedPoint, Message; inputs pt: Point3d, plane: Plane; same code as vertproj
panel_5 = Panel(vertproj_2.Message)
pl_origin_2 = PlaneOrigin(Base=plane_finder_2.output_plane, Origin=vertproj_2.ProjectedPoint)
prot_2 = RotatePlane(Plane=pl_origin_2, Angle=degrees(Slider(246, range=0..360)))

# ---- group: VIZ
dots = DotDisplay(Point=vertproj.ProjectedPoint, Colour=ColourSwatch(SwatchColor=RGB(31, 110, 207)), Size=Slider(0.5, range=0..1))

dots_2 = DotDisplay(Point=vertproj_2.ProjectedPoint, Colour=ColourSwatch(SwatchColor=RGB(31, 110, 207)), Size=Slider(0.5, range=0..1))

# ----
boundary_curve = Curve(boundary_curve_custom)
list = ValueList({"rectangular", "offset_rectangular", "hexagonal", "triangular"}, selected="rectangular")
rotatedplane = Plane(prot)
gridpattern = GridPatternGeneratorAndTrimmer(
    boundary=boundary_curve,
    origin_plane=rotatedplane,
    grid_type=list,
    x_dim=Slider(1, range=0..1),
    y_dim=Slider(0.4, range=0..1))  # -> out, allTiles, panelStatus, fullCount, trimCount, fullTiles; inputs boundary: Curve
# ---------- gridpattern: Python ----------
import Rhino
import math
import System
from Rhino.Geometry import Rectangle3d, Plane, Point3d, Curve, Transform
from Rhino.Geometry.Intersect import Intersection

# Update component info
ghenv.Component.Name = "Grid Pattern Generator and Trimmer"
ghenv.Component.NickName = "GridPattern"
ghenv.Component.Message = ""

# Initialize debug messages list globally
debug_messages = []

def debug_print(msg):
    # Only add to out parameter, not to component message
    print(msg)
    debug_messages.append(msg)

class GridCell:
    def __init__(self):
        self.curve = None
        self.center = None
        self.corners = []
    
    def get_test_points(self):
        return self.corners + [self.center] if self.center else self.corners
    
    def transform(self, xform):
        if self.curve:
            self.curve.Transform(xform)
        if self.center:
            self.center.Transform(xform)
        for i in range(len(self.corners)):
            self.corners[i].Transform(xform)

class GridGenerator:
    def __init__(self, boundary, cell_width, cell_height, grid_type="rectangular", plane=Plane.WorldXY):
        self.boundary = boundary
        self.cell_width = cell_width
        self.cell_height = cell_height
        self.grid_type = grid_type
        self.plane = plane
        
        # Create transforms between world and local coordinates
        self.to_local = Transform.PlaneToPlane(self.plane, Plane.WorldXY)
        self.to_world = Transform.PlaneToPlane(Plane.WorldXY, self.plane)
        
        # Transform boundary to local coordinates for calculations
        self.local_boundary = boundary.DuplicateCurve()
        self.local_boundary.Transform(self.to_local)
        
        # Get bounding box in local coordinates
        self.bbox = self.local_boundary.GetBoundingBox(True)
        debug_print(f"Local boundary box: Min({self.bbox.Min}), Max({self.bbox.Max})")
    
    def create_rectangular_cell(self, x, y, offset=0):
        cell = GridCell()
        # Apply offset to x-coordinate
        adjusted_x = x + offset
        
        cell.curve = Rectangle3d(
            Plane.WorldXY, 
            Point3d(adjusted_x, y, 0), 
            Point3d(adjusted_x + self.cell_width, y + self.cell_height, 0)
        ).ToNurbsCurve()
        cell.center = Point3d(adjusted_x + self.cell_width/2, y + self.cell_height/2, 0)
        cell.corners = [
            Point3d(adjusted_x, y, 0),
            Point3d(adjusted_x + self.cell_width, y, 0),
            Point3d(adjusted_x + self.cell_width, y + self.cell_height, 0),
            Point3d(adjusted_x, y + self.cell_height, 0)
        ]
        return cell
    
    def create_hexagonal_cell(self, center_x, center_y):
        cell = GridCell()
        radius = self.cell_width / 2
        corners = []
        for i in range(6):
            angle = i * math.pi / 3
            x = center_x + radius * math.cos(angle)
            y = center_y + radius * math.sin(angle)
            corners.append(Point3d(x, y, 0))
        
        cell.corners = corners
        cell.center = Point3d(center_x, center_y, 0)
        cell.curve = Curve.CreateInterpolatedCurve(corners + [corners[0]], 1)
        return cell
    
    def create_triangular_cell(self, base_x, base_y, inverted=False):
        cell = GridCell()
        height = self.cell_width * math.sqrt(3)/2
        
        if not inverted:
            corners = [
                Point3d(base_x, base_y, 0),
                Point3d(base_x + self.cell_width, base_y, 0),
                Point3d(base_x + self.cell_width/2, base_y + height, 0)
            ]
        else:
            corners = [
                Point3d(base_x + self.cell_width/2, base_y, 0),
                Point3d(base_x + self.cell_width, base_y + height, 0),
                Point3d(base_x, base_y + height, 0)
            ]
        
        cell.corners = corners
        cell.center = Point3d(sum(p.X for p in corners)/3, sum(p.Y for p in corners)/3, 0)
        cell.curve = Curve.CreateInterpolatedCurve(corners + [corners[0]], 1)
        return cell
    
    def generate_cells(self):
        debug_print(f"Generating {self.grid_type} grid with cell size: {self.cell_width} x {self.cell_height}")
        
        cells = []
        if self.grid_type in ["rectangular", "offset_rectangular"]:
            x = math.floor(self.bbox.Min.X / self.cell_width) * self.cell_width
            while x < self.bbox.Max.X:
                y = math.floor(self.bbox.Min.Y / self.cell_height) * self.cell_height
                row_index = int((y - self.bbox.Min.Y) / self.cell_height)
                
                while y < self.bbox.Max.Y:
                    # For offset_rectangular, apply 0.5 * cell_width offset on alternate rows
                    offset = (0.5 * self.cell_width) if (self.grid_type == "offset_rectangular" and row_index % 2 == 1) else 0
                    cell = self.create_rectangular_cell(x, y, offset)
                    cells.append(cell)
                    y += self.cell_height
                    row_index += 1
                x += self.cell_width
                
        elif self.grid_type == "hexagonal":
            h_spacing = self.cell_width * 3/4
            v_spacing = self.cell_width * math.sqrt(3)/2
            x = math.floor(self.bbox.Min.X / h_spacing) * h_spacing
            row_count = 0
            while x < self.bbox.Max.X:
                y = math.floor(self.bbox.Min.Y / v_spacing) * v_spacing
                offset = (v_spacing/2) if row_count % 2 else 0
                while y < self.bbox.Max.Y:
                    cell = self.create_hexagonal_cell(x, y + offset)
                    cells.append(cell)
                    y += v_spacing
                row_count += 1
                x += h_spacing
                
        elif self.grid_type == "triangular":
            height = self.cell_width * math.sqrt(3)/2
            x = math.floor(self.bbox.Min.X / self.cell_width) * self.cell_width
            while x < self.bbox.Max.X:
                y = math.floor(self.bbox.Min.Y / height) * height
                while y < self.bbox.Max.Y:
                    cells.append(self.create_triangular_cell(x, y, False))
                    cells.append(self.create_triangular_cell(x, y, True))
                    y += height
                x += self.cell_width
                
        debug_print(f"Generated {len(cells)} cells")
        return cells

def point_containment_test(point, curve, plane, tolerance=0.001):
    containment = curve.Contains(point, plane, tolerance)
    return containment == Rhino.Geometry.PointContainment.Inside

try:
    # Clear previous debug messages
    debug_messages = []
    debug_print("Starting script execution")
    
    # Input validation
    if not boundary:
        raise ValueError("No boundary curve provided")
    
    if isinstance(boundary, list):
        boundaries = [b.ToNurbsCurve() if isinstance(b, Rhino.Geometry.PolylineCurve) else b for b in boundary]
    else:
        boundaries = [boundary.ToNurbsCurve() if isinstance(boundary, Rhino.Geometry.PolylineCurve) else boundary]
    
    for b in boundaries:
        if not b.IsClosed:
            raise ValueError("All boundaries must be closed curves")
    
    grid_type = grid_type if grid_type else "rectangular"
    x_dim = x_dim if x_dim else 1.0
    y_dim = y_dim if y_dim else 1.0
    origin_plane = origin_plane if origin_plane else Plane.WorldXY
    
    debug_print(f"Processing with parameters: grid_type={grid_type}, x_dim={x_dim}, y_dim={y_dim}")
    
    # Initialize outputs with better names
    all_grid_cells = []  # instead of a
    cell_trim_status = []  # instead of b
    complete_cell_count = 0  # instead of c
    trimmed_cell_count = 0  # instead of d
    complete_cells_only = []  # instead of e
    
    for boundary_curve in boundaries:
        debug_print(f"Processing boundary: {boundary_curve}")
        
        # Generate grid
        grid = GridGenerator(boundary_curve, x_dim, y_dim, grid_type, origin_plane)
        cells = grid.generate_cells()
        
        # Process cells
        for cell in cells:
            # Transform cell to world coordinates for intersection testing
            cell.transform(grid.to_world)
            test_points = cell.get_test_points()
            points_inside = [point_containment_test(pt, boundary_curve, origin_plane) for pt in test_points]
            
            intersection_events = Intersection.CurveCurve(cell.curve, boundary_curve, 0.001, 0.001)
            has_intersection = intersection_events is not None and intersection_events.Count > 0
            
            if all(points_inside):
                all_grid_cells.append(cell.curve)
                complete_cells_only.append(cell.curve)
                cell_trim_status.append(0)
                complete_cell_count += 1
            elif any(points_inside) or has_intersection:
                intersect_curves = Rhino.Geometry.Curve.CreateBooleanIntersection(cell.curve, boundary_curve)
                if intersect_curves and len(intersect_curves) > 0:
                    for trimmed_curve in intersect_curves:
                        all_grid_cells.append(trimmed_curve)
                        cell_trim_status.append(1)
                        trimmed_cell_count += 1
    
    debug_print(f"Final counts - Complete cells: {complete_cell_count}, Trimmed cells: {trimmed_cell_count}")
    
    # Update component message to be cleaner
    ghenv.Component.Message = f"{grid_type.capitalize()} Grid\n{complete_cell_count} complete | {trimmed_cell_count} trimmed"
    
    # Set outputs with your preferred names
    allTiles = all_grid_cells
    panelStatus = cell_trim_status
    fullCount = complete_cell_count
    trimCount = trimmed_cell_count
    fullTiles = complete_cells_only
    
    # Assign to component outputs
    a = allTiles
    b = panelStatus
    c = fullCount
    d = trimCount
    e = fullTiles
    
    # Combine all debug messages into the out parameter
    out = "\n".join(debug_messages)

except Exception as e:
    error_msg = f"Error: {str(e)}\nType: {type(e)}"
    print(error_msg)
    ghenv.Component.Message = "Error occurred"
    a, b, c, d, e = None, None, None, None, None
    out = error_msg
# ---------- end gridpattern ----------
panel_6 = Panel(gridpattern.fullCount)
panelstatus = Boolean(gridpattern.panelStatus)
panel_7 = Panel(gridpattern.trimCount)
alltiles = Curve(gridpattern.allTiles)
fulltiles = Curve(gridpattern.fullTiles)
cull = CullPattern(List=alltiles, CullPattern=panelstatus)
panel_8 = Panel(gridpattern.out)

boundary_curve_2 = Curve(boundary_curve_xy)
list_2 = ValueList({"rectangular", "offset_rectangular", "hexagonal", "triangular"}, selected="hexagonal")
rotatedplane_2 = Plane(prot_2)
gridpattern_2 = GridPatternGeneratorAndTrimmer(
    boundary=boundary_curve_2,
    origin_plane=rotatedplane_2,
    grid_type=list_2,
    x_dim=Slider(1, range=0..1),
    y_dim=Slider(0.4, range=0..1))  # -> out, allTiles, panelStatus, fullCount, trimCount, fullTiles; inputs boundary: Curve; same code as gridpattern
panel_9 = Panel(gridpattern_2.fullCount)
panelstatus_2 = Boolean(gridpattern_2.panelStatus)
panel_10 = Panel(gridpattern_2.trimCount)
alltiles_2 = Curve(gridpattern_2.allTiles)
fulltiles_2 = Curve(gridpattern_2.fullTiles)
cull_2 = CullPattern(List=alltiles_2, CullPattern=panelstatus_2)
panel_11 = Panel(gridpattern_2.out)

# ---- group: VIZ
offset = OffsetCurve(Curve=cull, Distance=Slider(-0.02, range=-0.1..0.1), Corners=1)
boundary_3 = BoundarySurfaces(Edges=offset)
preview = CustomPreview(Geometry=boundary_3, Material=ColourSwatch(SwatchColor=RGB(222, 124, 124)))

offset_2 = OffsetCurve(Curve=gridpattern.fullTiles, Distance=Slider(-0.02, range=-0.1..0.1), Corners=1)
boundary_4 = BoundarySurfaces(Edges=offset_2)
preview_2 = CustomPreview(Geometry=boundary_4, Material=ColourSwatch(SwatchColor=RGB(109, 242, 68)))

offset_3 = OffsetCurve(Curve=cull_2, Distance=Slider(-0.02, range=-0.1..0.1), Corners=1)
boundary_5 = BoundarySurfaces(Edges=offset_3)
preview_3 = CustomPreview(Geometry=boundary_5, Material=ColourSwatch(SwatchColor=RGB(222, 124, 124)))

offset_4 = OffsetCurve(Curve=gridpattern_2.fullTiles, Distance=Slider(-0.02, range=-0.1..0.1), Corners=1)
boundary_6 = BoundarySurfaces(Edges=offset_4)
preview_4 = CustomPreview(Geometry=boundary_6, Material=ColourSwatch(SwatchColor=RGB(109, 242, 68)))

previewlw_3 = CustomPreviewLineweights(
    Geometry=boundary_curve,
    Shader=ColourSwatch(SwatchColor=RGB(0, 140, 255)),
    Thickness=Slider(0.2, range=0..1),
    Absolute=True)

previewlw_4 = CustomPreviewLineweights(
    Geometry=boundary_curve_2,
    Shader=ColourSwatch(SwatchColor=RGB(0, 140, 255)),
    Thickness=Slider(0.2, range=0..1),
    Absolute=True)
